# Grasshopper definition basic.gh (Grasshopper 1.0.7)
# plug-ins: SimScale 

download = DownloadAndProcessResults(
    ProjectName="Grasshopper Integration Example - API",
    SimulationName="Boston",
    SimulationRunName="8 dir - multilevel",
    Run=Toggle(True))
reducemesh = ReduceMesh(SimScaleObject=download, TargetResolution="5")
speeds = CollectWindSpeeds(SimScaleObject=reducemesh, WindDirection="210", SpeedMultiplier="1")  # -> SimScaleObject, OutPath
simscalepaths = SimScalePaths(SimScaleObject=speeds.SimScaleObject)  # -> SpeedUpFactorPath, SingleSpeedPath
resultnames = GetResultNames(VTUFilePath=simscalepaths.SpeedUpFactorPath)
resultnames_2 = GetResultNames(VTUFilePath=speeds.OutPath)
item = ListItem(List=resultnames_2, Index="0", Wrap=True)
item_2 = ListItem(List=resultnames, Index=Slider(6, range=0..16), Wrap=True)
convert = VTUToRhinoMesh(VTUFilePath=simscalepaths.SpeedUpFactorPath, Field=item_2)  # -> Mesh, DataValues
convert_2 = VTUToRhinoMesh(VTUFilePath=speeds.OutPath, Field=item)  # -> Mesh, DataValues
heatmap = LBSpatialHeatmap(values=convert.DataValues, mesh=convert.Mesh, legend_title=item_2)  # -> mesh, legend, title, colors, legend_par; plug-in component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
demesh = DeconstructMesh(Mesh=convert_2.Mesh)  # -> Vertices, Faces, Colours, Normals
heatmap_2 = LBSpatialHeatmap(values=convert_2.DataValues, mesh=convert_2.Mesh, legend_title=item)  # -> mesh, legend, title, colors, legend_par; plug-in component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
