# Grasshopper definition basic_humantosky_example.gh (Grasshopper 1.0.7)
# plug-ins: SimScale 

panel = Panel("http://climate.onebuilding.org/WMO_Region_2_Asia/SAU_Saudi_Arabia/RI_Riyadh/SAU_RI_Riyadh.AB.404380_TMYx.zip")
download = DownloadAndProcessResults(
    ProjectName="Grasshopper Integration Example - API",
    SimulationName="Boston",
    SimulationRunName="8 dir - multilevel",
    Run=Toggle(True))
downloadepw = LBDownloadWeather(weather_URL=panel)  # -> epw_file, stat_file, ddy_file; plug-in component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
reducemesh = ReduceMesh(SimScaleObject=download, TargetResolution="5")
importepw = LBImportEPW(epw_file=downloadepw.epw_file)  # -> location, dry_bulb_temperature, dew_point_temperature, relative_humidity, wind_speed, wind_direction, direct_normal_rad, diffuse_horizontal_rad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; plug-in component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
xdata = LBDeconstructData(data=importepw.wind_speed)  # -> header, values; plug-in component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
windrose = LBWindRose(data=importepw.wind_speed, wind_direction=importepw.wind_direction)  # -> report, mesh, compass, orient_line, freq_line, windrose_line, legend, title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; plug-in component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
avr = Average(Input=flatten(xdata.values))
speeds = CollectWindSpeeds(SimScaleObject=reducemesh, WindDirection=windrose.prevailing, SpeedMultiplier=avr)  # -> SimScaleObject, OutPath
resultnames = GetResultNames(VTUFilePath=speeds.OutPath)
item = ListItem(List=resultnames, Index="0", Wrap=True)
convert = VTUToRhinoMesh(VTUFilePath=speeds.OutPath, Field=item)  # -> Mesh, DataValues
demesh = DeconstructMesh(Mesh=convert.Mesh)  # -> Vertices, Faces, Colours, Normals
heatmap = LBSpatialHeatmap(values=convert.DataValues, mesh=convert.Mesh, legend_title=item)  # -> mesh, legend, title, colors, legend_par; plug-in component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
geo = Geometry([<brep referenced from the Rhino model> x10])
humantosky = LBHumanToSkyRelation(location=importepw.location, position=flatten(demesh.Vertices), context=flatten(geo), height="0", run=Toggle(False))  # -> report, human_points, human_line, fract_body_exp, sky_exposure; plug-in component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
outdoorsolarmrt = LBOutdoorSolarMRT(
    location=importepw.location,
    surface_temp=importepw.dry_bulb_temperature,
    dir_norm_rad=importepw.direct_normal_rad,
    diff_horiz_rad=importepw.diffuse_horizontal_rad,
    horiz_infrared=importepw.horizontal_infrared_rad,
    sky_exposure=humantosky.sky_exposure,
    run=Toggle(False))  # -> report, short_erf, long_erf, short_dmrt, long_dmrt, mrt; plug-in component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
utci = LBUTCIComfort(
    air_temp=importepw.dry_bulb_temperature,
    mrt=outdoorsolarmrt.mrt,
    rel_humid=importepw.relative_humidity,
    wind_vel=convert.DataValues,
    run=Toggle(False))  # -> report, utci, comfort, condition, category, comf_obj; plug-in component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
xdata_2 = LBDeconstructData(data=utci.utci)  # -> header, values; plug-in component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
avr_2 = Average(Input=xdata_2.values)  # -> flatten(ArithmeticMean)
heatmap_2 = LBSpatialHeatmap(values=avr_2, mesh=convert.Mesh, legend_title=xdata_2.header)  # -> mesh, legend, title, colors, legend_par; plug-in component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
